# Grasshopper definition A2 Try 1.gh (Grasshopper 1.0.7)

number_slider = Slider(3, range=0..100)
number_slider_2 = Slider(20, range=0..100)
number_slider_3 = Slider(6, range=3..100)
division = Division(A=number_slider, B=Slider(-2, range=-50..50))
subtraction = Subtraction(A=Slider(48, range=0..100), B=number_slider_2)
polygon = Polygon(Plane=PlaneXY(0, 0, 0), Radius=Slider(48, range=0..100), Segments=number_slider_3, FilletRadius=0)  # -> Polygon, Length
rectangle = Rectangle(Plane=PlaneXY(0, 0, 0), XSize=number_slider, YSize=number_slider_2, Radius=0)  # -> Rectangle, Length
vector_xyz = VectorXYZ(XComponent=division, YComponent=subtraction, ZComponent=0)  # -> Vector, Length
move = Move(Geometry=rectangle.Rectangle, Motion=vector_xyz.Vector)  # -> Geometry, Transform
polar_array = PolarArray(Geometry=move.Geometry, Plane=PlaneXY(0, 0, 0), Count=number_slider_3, Angle=6.283185307)  # -> Geometry, Transform
rotate = Rotate(Geometry=polar_array.Geometry, Angle=Slider(-11, range=-50..50), Plane=PlaneXY(0, 0, 0))  # -> Geometry, Transform
trim_with_regions = TrimWithRegions(Curve=polygon.Polygon, Regions=rotate.Geometry)  # -> Inside, flatten(Outside)
trim_with_regions_2 = TrimWithRegions(Curve=rotate.Geometry, Regions=polygon.Polygon)  # -> flatten(Inside), Outside
vector_xyz_2 = VectorXYZ(XComponent=0, YComponent=0, ZComponent=number_slider)  # -> Vector, Length
join_curves = JoinCurves(Curves=[trim_with_regions_2.Inside, trim_with_regions.Outside], Preserve=False)
extrude = Extrude(Base=join_curves, Direction=vector_xyz_2.Vector)
